# Grasshopper definition GeoOpt_mesh_a.gh (Grasshopper 1.0.7)
# plug-ins: Hops

number_slider = Slider(8, range=0..10)
concat = Concatenate(FragmentA="http://127.0.0.1:5000", FragmentB="/gridMesh")
concat_2 = Concatenate(FragmentA="http://127.0.0.1:5000", FragmentB="/meshFromPoints")
pt = Point([Point(-63.97162354, -3.207099448, 0), Point(-38.47622018, 61.96124827, 0), Point(27.9242225, 82.28275628, 0), Point(59.14813448, 39.29239223, 0), Point(109.3555608, -33.05425799, 0), Point(39.86092598, -106.9923514, 0), Point(0.3034014839, -54.30032169, 0), Point(-61.15889749, -69.5619003, 0)])
concat_3 = Concatenate(FragmentA="http://127.0.0.1:5000", FragmentB="/meshToGraph")
mplane = MeshPlane(
    Boundary={Plane=PlaneXY(0, 0, 0), Size=Domain2(u=-10..10, v=-10..10)},
    WidthCount=number_slider,
    HeightCount=number_slider)  # -> Mesh, Area
points = PointList(Points=pt, Size=Slider(12, range=0..100))
hops = Hops(
    _Path=concat,
    CacheResultsInMemory=True,
    CacheSolveResults=True,
    RemoteDefinitionLocation="http://127.0.0.1:5000/gridMesh",
    RemoteSolveVersion=(0, 1, 0),
    ShowInput_Enabled=False,
    ShowInput_Path=True,
    SynchronousSolve=True)
hops_2 = Hops(
    _Path=concat_2,
    Points=pt,
    CacheResultsInMemory=False,
    CacheSolveResults=True,
    RemoteDefinitionLocation="http://127.0.0.1:5000/meshFromPoints",
    RemoteSolveVersion=(0, 1, 0),
    ShowInput_Enabled=False,
    ShowInput_Path=True,
    SynchronousSolve=True)
panel = Panel(mplane.Mesh)
panel_2 = Panel(hops_2)
demesh = DeconstructMesh(Mesh=hops_2)  # -> Vertices, Faces, Colours, Normals
hops_3 = Hops(
    _Path=concat_3,
    InputMesh=mplane.Mesh,
    Plot=Button(),
    CacheResultsInMemory=False,
    CacheSolveResults=True,
    RemoteDefinitionLocation="http://127.0.0.1:5000/meshToGraph",
    RemoteSolveVersion=(0, 1, 0),
    ShowInput_Enabled=False,
    ShowInput_Path=True,
    SynchronousSolve=True)
panel_3 = Panel(hops_3)
